# Grasshopper definition 01_gridbased_analysis.gh (Grasshopper 0.9.76)
# plug-ins: Python Interpreter

ladybug = Ladybug_Ladybug()  # -> Vviiiiiiiiiizzz; plug-in component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
constructlocation = Ladybug_ConstructLocation(locationName="unknown_Location", latitude="36", longitude=0, timeZone=0, elevation=0)  # -> location; plug-in component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
panel = Panel("12")
panel_2 = Panel("9")
panel_3 = Panel("21")
number_slider = Slider(23, range=0..100)
brep = Brep(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)
ciesky = HoneybeePlus_CIEStandardSky(location=constructlocation, month=6, day=21, skyType=0)  # -> sky; plug-in component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
panel_4 = Panel(ciesky)
radopaquematerial = HoneybeePlus_RadianceOpaqueMaterial(name="wall", reflect=".55", spec=0, rough=0)  # -> material; plug-in component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
panel_5 = Panel("""1
2
3
4
5""")
wires = BrepWireframe(Brep=brep, Density=-1)
gentestpts = Honeybee_GenerateTestPoints(testGeometry=brep, gridSize=".5", distBaseSrf=Slider(0.762, range=0..1), moveTestMesh=True)  # -> readMe, simplify(testPoints), simplify(ptsVectors), simplify(facesArea), simplify(mesh); plug-in component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
radglassmaterial = HoneybeePlus_RadianceGlassMaterial(name="g_material", TVis=".6")  # -> material; plug-in component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
brep_2 = Brep(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)
panel_6 = Panel(radopaquematerial)
panel_7 = Panel(radglassmaterial)
preview = CustomPreview(Geometry=brep_2, Shader=ColourSwatch(SwatchColor=RGBA(211, 208, 255, 64)))
wires_2 = BrepWireframe(Brep=brep_2, Density=-1)
brep_3 = Brep([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])

# ---- group: change the path to honeybeex folder
panel_8 = Panel("""C:\Users\Administrator\Documents\GitHub\honeybee
C:\Users\Administrator\Documents\GitHub\honeybee-plus""")
python = PythonScript(path_to_honeybee_libs=panel_8)  # -> readMe; inputs path_to_honeybee_libs: list
# ---------- python: Python ----------
import sys

if path_to_honeybee_libs:
    for p in path_to_honeybee_libs:
        sys.path.append(p)

import honeybee_grasshopper
import honeybee
import honeybee.hbsurface
# ---------- end python ----------

# ----
wires_3 = BrepWireframe(Brep=brep_3, Density=-1)
analysisgrid = HoneybeePlus_AnalysisGrid(testPoints=gentestpts.testPoints, ptsVectors=gentestpts.ptsVectors)  # -> analysisGrid; plug-in component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
brep_4 = Brep(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)
hbsurface = HoneybeePlus_HoneybeeSurface(geo=brep_2, name="glass_wall", radMat=radglassmaterial)  # -> readMe, HBSrf; plug-in component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
debrep = DeconstructBrep(Brep=brep_4)  # -> Faces, Edges, Vertices
hbsurface_2 = HoneybeePlus_HoneybeeSurface(geo=brep_3, name=panel_5, radMat=radopaquematerial)  # -> readMe, HBSrf; plug-in component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
hbsurface_3 = HoneybeePlus_HoneybeeSurface(geo=debrep.Faces)  # -> readMe, HBSrf; plug-in component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

# ---- group: analysis recipe
gridbasedrecipe = HoneybeePlus_GridBasedRecipe(sky=ciesky, analysisGrids=analysisgrid, analysisType=0)  # -> analysisRecipe; plug-in component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

# ---- group: visualizeGeometry
python_2 = PythonScript(HBObjs=hbsurface.HBSrf)  # -> geo; inputs HBObjs: list
# ---------- python_2: Python ----------
geo = (hbo.geometry for hbo in HBObjs if hasattr(hbo, 'geometry'))
# ---------- end python_2 ----------

# ----
python_3 = PythonScript(_write=False)
panel_9 = Panel(hbsurface_2.HBSrf)
panel_10 = Panel(gridbasedrecipe)
python_4 = PythonScript(RadianceFiles=python_3)
panel_11 = Panel("test room")
data = Data(flatten([hbsurface_2.HBSrf, hbsurface.HBSrf, hbsurface_3.HBSrf]))
toggle = BooleanToggle(False)
runradiance = HoneybeePlus_RunRadianceAnalysis(analysisRecipe=gridbasedrecipe, HBObjects=data, folder="c:\ladybug", name="untitled", write=toggle, run=toggle)  # -> readMe, results; plug-in component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
panel_12 = Panel(runradiance.readMe)
legendpar = Ladybug_LegendParameters(highBound="500")  # -> legendPar; plug-in component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

panel_13 = Panel("C:\Users\Administrator\Documents\GitHub\honeybee-plus\plugin\grasshopper")
exportladybug = Ladybug_ExportLadybug(targetFolder=panel_13, export=Toggle(False))  # -> readMe; plug-in component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

recolormesh = Ladybug_RecolorMesh(analysisResult=runradiance.results, inputMesh=gentestpts.mesh, legendPar=legendpar)  # -> readMe, newMesh, newLegend, legendBasePt, meshColors, legendColors; plug-in component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
