# Grasshopper definition 05_three_phase_daylight_analysis.gh (Grasshopper 0.9.76)
# plug-ins: Python Interpreter

panel = Panel("C:\Users\Administrator\Documents\GitHub\honeybee\tests\room\xmls\clear.xml")
brep = Brep([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])
brep_2 = Brep(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)
panel_2 = Panel("""north_glass_1
north_glass_2""")
radbsdfmaterial = HoneybeePlus_RadianceBSDFMaterial(xmlfile=panel, upOrientation=Vector(0.01, 0.01, 1), thickness=0)  # -> material; plug-in component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
panel_3 = Panel("C:\Users\Administrator\Documents\GitHub\honeybee\tests\room\xmls\diffuse50.xml")
panel_4 = Panel("C:\Users\Administrator\Documents\GitHub\honeybee\tests\room\xmls\clear.xml")
wires = BrepWireframe(Brep=brep, Density=-1)
preview = CustomPreview(Geometry=brep, Shader=ColourSwatch(SwatchColor=RGBA(211, 208, 255, 64)))
preview_2 = CustomPreview(Geometry=brep_2, Shader=ColourSwatch(SwatchColor=RGBA(211, 208, 255, 64)))
pt = ConstructPoint(XCoordinate="0.5", YCoordinate="0.5", ZCoordinate=0)
path = FilePath("C:\EnergyPlusV8-3-0\WeatherData\USA_CA_San.Francisco.Intl.AP.724940_TMY3.epw")
hbwinsrf = HoneybeePlus_HoneybeeWindowSurface(geo=brep, name=panel_2)  # -> readMe, HBWindowSrf; plug-in component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
radbsdfmaterial_2 = HoneybeePlus_RadianceBSDFMaterial(xmlfile=[panel_4, panel_3], upOrientation=Vector(0.01, 0.01, 1), thickness=0)  # -> material; plug-in component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

# ---- group: This window will be it's own group
hbwinsrf_2 = HoneybeePlus_HoneybeeWindowSurface(geo=brep_2, name="skylight", radMat=radbsdfmaterial)  # -> readMe, HBWindowSrf; plug-in component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

# ----
brep_3 = Brep(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)
debrep = DeconstructBrep(Brep=brep)  # -> Faces, Edges, Vertices
evalsrf = EvaluateSurface(Surface=reparameterize(brep), Point=pt)  # -> Point, Normal, Frame
wires_2 = BrepWireframe(Brep=brep_3, Density=-1)
gentestpts = Honeybee_GenerateTestPoints(testGeometry=brep_3, gridSize="2", distBaseSrf=Slider(0.762, range=0..1), moveTestMesh=True)  # -> readMe, simplify(testPoints), simplify(ptsVectors), simplify(facesArea), simplify(mesh); plug-in component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

# ---- group: change the path to honeybeex folder
panel_5 = Panel("""ladybug
honeybee
honeybee-plus""")
concat = Concatenate(FragmentA="C:\Users\Administrator\Documents\GitHub\", FragmentB=panel_5)
python = PythonScript(path_to_honeybee_libs=concat)  # -> readMe; inputs path_to_honeybee_libs: list
# ---------- python: Python ----------
import sys

if path_to_honeybee_libs:
    for p in path_to_honeybee_libs:
        sys.path.append(p)

import honeybee_grasshopper
import honeybee
import honeybee.hbsurface
# ---------- end python ----------

# ----
brep_4 = Brep([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])
number_slider = Slider(12, range=0..100)
panel_6 = Panel("180")
wea = HoneybeePlus_Wea(epwFile=path)  # -> wea; plug-in component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
wires_3 = BrepWireframe(Brep=brep_4, Density=-1)
panel_7 = Panel("""1
2
3
4
5
6""")
series = Series(Start=0, Step=1, Count=10)
points = PointList(Points=gentestpts.testPoints)
preview_3 = CustomPreview(Geometry=wires_3, Shader=ColourSwatch(SwatchColor=RGB(0, 0, 0)))
hbwindowgroup = HoneybeePlus_HoneybeeWindowGroup(name="group_1", bsdfMaterials=radbsdfmaterial_2, HBWindowSrfs=hbwinsrf.HBWindowSrf)  # -> HBWindowGroup; plug-in component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
genclimatebasedsky = Honeybee_GenerateClimateBasedSky(north=Slider(20, range=0..100), weatherFile=path, month=number_slider, day=number_slider, hour=number_slider)  # -> radiationValues, skyFilePath; plug-in component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
skymatrix = HoneybeePlus_SkyMatrix(north=0, wea=wea, skyDensity=1)  # -> skyMTX; plug-in component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
analysisgrid = HoneybeePlus_AnalysisGrid(testPoints=gentestpts.testPoints)  # -> analysisGrid; plug-in component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

# ---- group: context!
brep_5 = Brep(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)
debrep_2 = DeconstructBrep(Brep=brep_5)  # -> Faces, Edges, Vertices
hbsurface = HoneybeePlus_HoneybeeSurface(geo=debrep_2.Faces)  # -> readMe, HBSrf; plug-in component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

# ----
skyvector = HoneybeePlus_SkyVector(north=0, wea=wea, month=6, day=21, hour=Slider(15, range=0..100))  # -> skyVec; plug-in component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
hbsurface_2 = HoneybeePlus_HoneybeeSurface(geo=brep_4, name=panel_7)  # -> readMe, HBSrf; plug-in component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
file = ReadFile(File=genclimatebasedsky.skyFilePath, PerLineParse=True)
threephasegbrecipe = HoneybeePlus_GridBasedThreePhaseDaylightRecipe(skyMTX=skyvector, analysisGrid=analysisgrid, analysisType=0, reuseViewMTX=True, reuseDaylightMTX=True)  # -> analysisRecipe; plug-in component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
hbtorad = HoneybeePlus_WriteHBObjectsToRadiance(hbObjects=hbsurface.HBSrf, folder="c:\ladybug\untitled", filename="threePhase_context", write=Toggle(True))  # -> radFile; plug-in component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
panel_8 = Panel(file)
python_2 = PythonScript()  # -> out, a
# ---------- python_2: Python ----------
import honeybee
honeybee.config.perlExePath = r"C:\Program Files\OpenStudio 1.13.0\strawberry-perl-5.16.2.1-32bit-portable-reduced\perl\bin\perl.exe"
# ---------- end python_2 ----------
panel_9 = Panel("C:\Users\Administrator\Documents\GitHub\honeybee-plus\plugin\grasshopper")
radscene = HoneybeePlus_RadianceScene(radFiles=hbtorad, copyLocal=True, overwrite=False)  # -> radScene; plug-in component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
data = Data(flatten([hbsurface_2.HBSrf, hbwindowgroup, hbwinsrf_2.HBWindowSrf]))
panel_10 = Panel(threephasegbrecipe)
number_slider_2 = Slider(2, range=0..10)
toggle = BooleanToggle(False)

# ---- group: visualizeGeometry
python_3 = PythonScript()  # -> geo; inputs HBObjs: list
# ---------- python_3: Python ----------
geo = (hbo.geometry for hbo in HBObjs if hasattr(hbo, 'geometry'))
# ---------- end python_3 ----------

# ----
panel_11 = Panel("test_2")
exportladybug = Ladybug_ExportLadybug(targetFolder=panel_9, export=Toggle(True))  # -> readMe; plug-in component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
number_slider_3 = Slider(11, range=7..20)
runradiance = HoneybeePlus_RunRadianceAnalysis(
    analysisRecipe=threephasegbrecipe,
    HBObjects=data,
    radScene=radscene,
    folder="c:\ladybug",
    name="untitled",
    write=toggle,
    run=toggle)  # -> readMe, results; plug-in component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
panel_12 = Panel("100")
doy_hoy = Ladybug_DOY_HOY(days="21", months="8", hours=number_slider_3)  # -> HOY, DOY, date; plug-in component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
importlocation = Ladybug_ImportLocation(epwFile=path)  # -> location; plug-in component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
panel_13 = Panel(runradiance.readMe)

# ---- group: get daylight autonomy
python_4 = PythonScript(workingHours="9 To 17", threshold=300, minUsefulIllum=100, maxUsefulIllum=2000)  # -> DA, CDA, UDI, less, more; inputs results: list, threshold: Int32, minUsefulIllum: Int32, maxUsefulIllum: Int32
# ---------- python_4: Python ----------
if _results and _results[0]:
    stTime, endTime = _workingHours_
    _DA = [0] * len(_results[0])
    _CDA = [0] * len(_results[0])
    _UDI =  [0] * len(_results[0])
    _less =  [0] * len(_results[0])
    _more =  [0] * len(_results[0])
    nOfHours = 0
    for HOY, result in enumerate(_results):
        if not stTime <= HOY % 24 < endTime:
            continue
        nOfHours += 1
        for ptCount, ill in enumerate(result):
            _ill = float(ill)
            if _ill >= _threshold_:
                _DA[ptCount] += 1
                _CDA[ptCount] += 1
            else:
                _CDA[ptCount] += _ill /_threshold_
            
            if _ill < _minUsefulIllum_:
                _less[ptCount] += 1
            elif _ill > _maxUsefulIllum_:
                _more[ptCount] += 1
            else:
                _UDI[ptCount] += 1
    
    # divide values by the number of hours
    DA = (v / nOfHours * 100 for v in _DA)
    CDA = (v / nOfHours * 100 for v in _CDA)
    UDI = (v / nOfHours * 100 for v in _UDI)
    less = (v / nOfHours * 100 for v in _less)
    more = (v / nOfHours * 100 for v in _more)
# ---------- end python_4 ----------

# ----
panel_14 = Panel(doy_hoy.HOY)
lng = ListLength(List=runradiance.results)
sunpath = Ladybug_SunPath(
    location=importlocation,
    hour=number_slider_3,
    day="21",
    month="8",
    timeStep=1,
    sunPathScale=".25",
    dailyOrAnnualSunPath=True)  # -> readMe, sunVectors, sunAltitudes, sunAzimuths, port, sunSpheresMesh, sunPathCrvs, legend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; plug-in component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
division = Division(A=lng, B=3)
partition = PartitionList(List=runradiance.results, Size="8760")

# ---- group: get annual results for an hour of year
python_5 = PythonScript(results=partition, hoy=Slider(4, range=0..10))  # -> illuminance; inputs results: list, hoy: Int32
# ---------- python_5: Python ----------
if _results and _results[0] and _hoy:
    illuminance = (float(i) for i in _results[_hoy])
# ---------- end python_5 ----------

# ----
ladybug = Ladybug_Ladybug()  # -> Vviiiiiiiiiizzz; plug-in component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
legendpar = Ladybug_LegendParameters(highBound="2000")  # -> legendPar; plug-in component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
recolormesh = Ladybug_RecolorMesh(analysisResult=python_5, inputMesh=gentestpts.mesh, legendPar=legendpar, legendTitle="lux")  # -> readMe, newMesh, newLegend, legendBasePt, meshColors, legendColors; plug-in component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
