# Grasshopper definition gridbased_sample.gh (Grasshopper 0.9.76)
# plug-ins: Python Interpreter

number_slider = Slider(200, range=0..1000)
number_slider_2 = Slider(2, range=0..10)
python = PythonScript(path_to_honeybee_libs="C:\Users\Administrator\Documents\GitHub\honeybeex")  # -> readMe
# ---------- python: Python ----------
from scriptcontext import sticky

sticky["hb_lib_path"] = path_to_honeybee_libs
# ---------- end python ----------

# ---- group: Radiance parameters
radpar = PythonScript(quality=Slider(0, range=0..10))  # -> radParameters; inputs quality: Int32, ab: Int32, ad: Int32, as: Int32, ar: Int32
# ---------- radpar: Python ----------
import sys
from scriptcontext import sticky

if "hb_lib_path" in sticky:
    sys.path.append(sticky["hb_lib_path"])

try:
    from honeybeex.radiance.parameters.gridbased import GridBasedParameters
    from honeybeex import wrapper
except ImportError:
    raise ImportError("Failed to import Honeybee libraries.\n" + \
                      "Set-up path to Honeybee libraries in honeybee_honeybee component")

if _quality is not None:
    radParameters = GridBasedParameters(_quality)
    if _ab_: radParameters.ab = _ab_
    if _ad_: radParameters.ad = _ad_
    if _as_: radParameters.as_ = _as_
    if _ar_: radParameters.ar = _ar_
    if _aa_: radParameters.aa = _aa_
    
    #wrap the object
    radParameters = wrapper.Wrapper(radParameters)
# ---------- end radpar ----------

# ----
brep = Brep(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)

# ---- group: sky library
sky = PythonScript(illuminanceValue="20000")  # -> HBSky
# ---------- sky: Python ----------
import sys
from scriptcontext import sticky

if "hb_lib_path" in sticky:
    sys.path.append(sticky["hb_lib_path"])

try:
    from honeybeex.radiance.sky.certainIlluminance import SkyWithCertainIlluminanceLevel
    from honeybeex.wrapper import Wrapper
except ImportError:
    raise ImportError("Failed to import Honeybee libraries.\n" + \
                      "Set-up path to Honeybee libraries in honeybee_honeybee component")

if _illuminanceValue:
    HBSky = Wrapper(SkyWithCertainIlluminanceLevel(_illuminanceValue))
# ---------- end sky ----------

# ----
panel = Panel("""1
2
3
4
5""")
python_2 = PythonScript(name="g_material", TVis=".65")  # -> material
# ---------- python_2: Python ----------
import sys
from scriptcontext import sticky

if "hb_lib_path" in sticky:
    sys.path.append(sticky["hb_lib_path"])

try:
    from honeybeex.radiance.material.glass import GlassMaterial
    from honeybeex.wrapper import Wrapper
except ImportError:
    raise ImportError("Failed to import Honeybee libraries.\n" + \
                      "Set-up path to Honeybee libraries in honeybee_honeybee component")



if _name and _TVis:
    material = GlassMaterial.bySingleTransValue(_name, _TVis)
    
    material = Wrapper(material)
# ---------- end python_2 ----------
brep_2 = Brep(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)
gentestpts = Honeybee_GenerateTestPoints(testGeometry=brep, gridSize=Slider(1, range=0..10), distBaseSrf=Slider(0.762, range=0..1), moveTestMesh=True)  # -> readMe, simplify(testPoints), simplify(ptsVectors), simplify(facesArea), simplify(mesh); plug-in component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
wires = BrepWireframe(Brep=brep, Density=-1)
python_3 = PythonScript(name="wall", reflect=".55", spec=0, rough=0)  # -> material
# ---------- python_3: Python ----------
import sys
from scriptcontext import sticky

if "hb_lib_path" in sticky:
    sys.path.append(sticky["hb_lib_path"])

try:
    from honeybeex.radiance.material.plastic import PlasticMaterial
    from honeybeex.wrapper import Wrapper
except ImportError:
    raise ImportError("Failed to import Honeybee libraries.\n" + \
                      "Set-up path to Honeybee libraries in honeybee_honeybee component")



if _name and _reflect:
    material = PlasticMaterial.bySingleReflectValue(_name, _reflect, _spec_, _rough_)
    
    material = Wrapper(material)
# ---------- end python_3 ----------
panel_2 = Panel(radpar)
panel_3 = Panel(python_2)
wires_2 = BrepWireframe(Brep=brep_2, Density=-1)
brep_3 = Brep([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])
preview = CustomPreview(Geometry=brep_2, Shader=ColourSwatch(SwatchColor=RGBA(211, 208, 255, 64)))
panel_4 = Panel(python_3)
python_4 = PythonScript(material=python_2)  # -> radProp
# ---------- python_4: Python ----------
import sys
from scriptcontext import sticky

if "hb_lib_path" in sticky:
    sys.path.append(sticky["hb_lib_path"])

try:
    from honeybeex.radiance.properties import RadianceProperties
    from honeybeex.wrapper import Wrapper
except ImportError:
    raise ImportError("Failed to import Honeybee libraries.\n" + \
                      "Set-up path to Honeybee libraries in honeybee_honeybee component")


radProp = RadianceProperties(_material_.unwrap(), True) if _material_ else RadianceProperties()
radProp = Wrapper(radProp)
# ---------- end python_4 ----------
wires_3 = BrepWireframe(Brep=brep_3, Density=-1)
pt = Point(gentestpts.testPoints)

# ---- group: I'm not sure if we need this extra step
python_5 = PythonScript(material=python_3)  # -> radProp; same code as python_4

# ----
panel_5 = Panel(python_4)
python_6 = PythonScript(geo=brep_2, name="glass_wall", radProp=python_4)  # -> readMe, HBSrf; inputs geo: GeometryBase, type: Int32
# ---------- python_6: Python ----------
import sys
from scriptcontext import sticky

if "hb_lib_path" in sticky:
    sys.path.append(sticky["hb_lib_path"])

try:
    from honeybeex.hbsurface import HBSurface
    from honeybeex.wrapper import Wrapper
except ImportError:
    raise ImportError("Failed to import Honeybee libraries.\n" + \
                      "Set-up path to Honeybee libraries in honeybee_honeybee component")

from uuid import uuid4

if _geo:
    
    isNameSetByUser = True
    if not name_:
        name_ = "Surface_%s" % uuid4()
        isNameSetByUser = False
        
    isTypeSetByUser = True
    if not _type_:
        isTypeSetByUser = False
    
    radProp_ = radProp_.unwrap() if radProp_ else None
    
    epProp_ = epProp_.unwrap() if epProp_ else None
    
    HBSrf = HBSurface(name_, _geo, _type_, isNameSetByUser,isTypeSetByUser,
                      radProp_, epProp_)

    HBSrf = Wrapper(HBSrf)
# ---------- end python_6 ----------
panel_6 = Panel(python_5)

# ---- group: analysis recipe
gridbased = PythonScript(HBSky=sky, testPoints=pt, radParameters=radpar)  # -> analysisRecipe; inputs testPoints: tree of Point3d, ptsVectors: tree of Vector3d, simulationType: Int32
# ---------- gridbased: Python ----------
import sys
from scriptcontext import sticky

if "hb_lib_path" in sticky:
    sys.path.append(sticky["hb_lib_path"])

try:
    from honeybeex.radiance.recipe.gridbased import GridBasedAnalysisRecipe
    from honeybeex import wrapper
except ImportError:
    raise ImportError("Failed to import Honeybee libraries.\n" + \
                      "Set-up path to Honeybee libraries in honeybee_honeybee component")

if _HBSky and _testPoints and ptsVectors_:
    if _radParameters_:
        _radParameters_ = _radParameters_.unwrap()
        
    analysisRecipe = GridBasedAnalysisRecipe(
        _HBSky.unwrap(), _testPoints, ptsVectors_, _simulationType_, _radParameters_
        )
    
    analysisRecipe = wrapper.Wrapper(analysisRecipe)
# ---------- end gridbased ----------

# ---- group: HBHive is not implemented yet- the component outputs the surface itself
python_7 = PythonScript(geo=brep_3, name=panel, radProp=python_5)  # -> readMe, HBSrf; inputs geo: GeometryBase, type: Int32
# ---------- python_7: Python ----------
import sys
from scriptcontext import sticky

if "hb_lib_path" in sticky:
    sys.path.append(sticky["hb_lib_path"])

try:
    from honeybeex.hbsurface import HBSurface
    from honeybeex.wrapper import Wrapper
except ImportError:
    raise ImportError("Failed to import Honeybee libraries.\n" + \
                      "Set-up path to Honeybee libraries in honeybee_honeybee component")

from uuid import uuid4

if _geo:
    
    isNameSetByUser = True
    if not name_:
        name_ = "Surface_%s" % uuid4()
        isNameSetByUser = False
        
    isTypeSetByUser = True
    if not _type_:
        isTypeSetByUser = False
    
    radProp_ = radProp_.unwrap() if radProp_ else None
    
    epProp_ = epProp_.unwrap() if epProp_ else None
    
    HBSrf = HBSurface(name_, _geo, _type_, isNameSetByUser, isTypeSetByUser,
                      radProp_, epProp_)

    HBSrf = Wrapper(HBSrf)
# ---------- end python_7 ----------

# ---- group: visualizeGeometry
python_8 = PythonScript()  # -> geo; inputs HBObjs: list
# ---------- python_8: Python ----------
geo = [hbo.unwrap().geometry for hbo in HBObjs if hasattr(hbo, 'unwrap')
    and hasattr(hbo.unwrap(), 'isHBObject')]
# ---------- end python_8 ----------

# ----
panel_7 = Panel(python_7.HBSrf)
toggle = BooleanToggle(True)
python_9 = PythonScript(
    recipe=gridbased,
    HBObjs=[python_7.HBSrf, python_6.HBSrf],
    folder="c:\ladybug",
    name="untitled",
    write=toggle,
    run=toggle)  # -> readMe, results; inputs HBObjs: tree, write: Boolean, run: Boolean
# ---------- python_9: Python ----------
_HBObjs.Flatten()
_HBObjs = _HBObjs.Branch(0)

if _HBObjs and _recipe and _write:
    try:
        _HBObjs = [objs.unwrap() for objs in _HBObjs]
    except AttributeError:
        raise AttributeError(" At least one of the inputs in _HBObjs is not a valid Honeybee object.")
   
    try:
       _recipe= _recipe.unwrap()
    except AttributeError:
        raise AttributeError(" Can't read the analysis recipe.")

    if _write:
        # Add Honeybee objects to the recipe
        _recipe.hbObjects = _HBObjs
        try:
            _recipe.writeToFile(_folder_, _name_)
        except AttributeError:
            raise ValueError(" Expected a recipe not a %s" % type(_recipe))

    if _write and run_:
        if _recipe.run(False):
            results = _recipe.results()
# ---------- end python_9 ----------

ladybug = Ladybug_Ladybug()  # -> Vviiiiiiiiiizzz; plug-in component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
recolormesh = Ladybug_RecolorMesh(analysisResult=python_9.results, inputMesh=gentestpts.mesh, heightDomain="0 To 2")  # -> readMe, newMesh, newLegend, legendBasePt, meshColors, legendColors; plug-in component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
